# Grasshopper definition shortestPath_EllieGalata.gh (Grasshopper 1.0.7)
# plug-ins: Hops

panel = Panel("""/gridMesh
/shortestpath""")
concat = Concatenate(FragmentA="http://127.0.0.1:5000", FragmentB=graft(panel))
bang = ExplodeTree(Data=concat)  # -> Branch0, Branch1
hops = Hops(
    _Path=bang.Branch0,
    UValue=Slider(11, range=0..20),
    VValue=Slider(13, range=0..20),
    CacheResultsInMemory=False,
    CacheSolveResults=False,
    RemoteDefinitionLocation="http://127.0.0.1:5000/gridMesh",
    RemoteSolveVersion=(0, 1, 0),
    ShowInput_Enabled=False,
    ShowInput_Path=True,
    SynchronousSolve=True)
hops_2 = Hops(
    _Path=bang.Branch1,
    InputMesh=hops,
    FaceIndex1=Slider(91, range=0..119),
    FaceIndex2=Slider(0, range=0..119),
    CacheResultsInMemory=False,
    CacheSolveResults=False,
    RemoteDefinitionLocation="http://127.0.0.1:5000/shortestpath",
    RemoteSolveVersion=(0, 1, 0),
    ShowInput_Enabled=False,
    ShowInput_Path=True,
    SynchronousSolve=True)
explodemesh = GhPythonScript(m=hops)  # -> out, a; inputs m: Mesh
# ---------- explodemesh: Python ----------
import Rhino.Geometry as rg

ghenv.Component.Message = "explode mesh"

exploded = []

for i in range(m.Faces.Count):
    m_copy = m.Duplicate()
    face = m_copy.Faces.ExtractFaces([i])
    exploded.append(face)
    
a = exploded
# ---------- end explodemesh ----------
item = ListItem(List=explodemesh.a, Index=hops_2, Wrap=True)
preview = CustomPreview(Geometry=item, Material=ColourSwatch(SwatchColor=RGBA(0, 0, 0, 130)))
